# Grasshopper definition grasssloper.ghx (Grasshopper 0.9.76)

number_slider = Slider(0.25, range=0..1)
number_slider_2 = Slider(0.25, range=0..1)
number_slider_3 = Slider(0.25, range=0..1)
bust = Slider(88, range=70..120)
expression = Expression(x=bust, Expression="x/24 + 3.4")
expression_2 = Expression(x=bust, Expression="x/2 + 6")
bust_2 = Number(bust)
waist = Slider(66, range=40..90)
expression_3 = Expression(x=bust, Expression="X/5 + 8.3")
expression_4 = Expression(x=bust, Expression="X/12 + 13.7")
center_back = Slider(36, range=30..90)
expression_5 = Expression(x=bust, Expression="x/32")
expression_6 = Expression(x=bust, Expression="X/8+7.4")
expression_7 = Expression(x=bust, Expression="x/8+6.2")
subtraction = Subtraction(A=expression_2, B=expression_7)
addition = Addition(A=expression, B=0.2)
expression_8 = Expression(x=center_back, y=addition, Expression="x+(1/3)*y")
subtraction_2 = Subtraction(A=subtraction, B=expression_5)
expression_9 = Expression(x=subtraction_2, y=expression_6, Expression="(x-y)/2+y")
subtraction_3 = Subtraction(A=center_back, B=expression_4)
expression_10 = Expression(x=expression_2, y=expression_7, Expression="x-y/2-0.7")
subtraction_4 = Subtraction(A=center_back, B=expression_4)
addition_2 = Addition(A=expression_3, B=subtraction_4)
A = ConstructPoint(XCoordinate=0, YCoordinate=0, ZCoordinate=0)
b2 = ConstructPoint(XCoordinate=expression_2, YCoordinate=0, ZCoordinate=0)
pt = ConstructPoint(XCoordinate=0, YCoordinate=subtraction_3, ZCoordinate=0)
B = ConstructPoint(XCoordinate=expression_2, YCoordinate=addition_2, ZCoordinate=0)
a2 = ConstructPoint(XCoordinate=0, YCoordinate=center_back, ZCoordinate=0)
pt_2 = ConstructPoint(XCoordinate=expression_2, YCoordinate=subtraction_3, ZCoordinate=0)
bp = ConstructPoint(XCoordinate=expression_10, YCoordinate=subtraction_3, ZCoordinate=0)
C = ConstructPoint(XCoordinate=expression_6, YCoordinate=subtraction_3, ZCoordinate=0)
pt_3 = ConstructPoint(XCoordinate=subtraction, YCoordinate=subtraction_3, ZCoordinate=0)
pt_4 = ConstructPoint(XCoordinate=expression_6, YCoordinate=center_back, ZCoordinate=0)
pt_5 = ConstructPoint(XCoordinate=subtraction, YCoordinate=addition_2, ZCoordinate=0)
pt_6 = ConstructPoint(XCoordinate=expression_9, YCoordinate=subtraction_3, ZCoordinate=0)
F = ConstructPoint(XCoordinate=subtraction_2, YCoordinate=subtraction_3, ZCoordinate=0)
pt_7 = ConstructPoint(XCoordinate=addition, YCoordinate=expression_8, ZCoordinate=0)
pt_8 = ConstructPoint(XCoordinate=expression_9, YCoordinate=0, ZCoordinate=0)
bl_line = Line(StartPoint=pt, EndPoint=pt_2)
back_width = Line(StartPoint=C, EndPoint=pt_4)
chest_width = Line(StartPoint=pt_3, EndPoint=pt_5)
ln = Line(StartPoint=pt_5, EndPoint=B)
ln_2 = Line(StartPoint=A, EndPoint=b2)
ln_3 = Line(StartPoint=A, EndPoint=a2)
ln_4 = Line(StartPoint=pt_6, EndPoint=pt_8)
ln_5 = Line(StartPoint=B, EndPoint=b2)
ln_6 = Line(StartPoint=a2, EndPoint=pt_4)
move = Move(Geometry=ln_6, Motion=Vector(0, -8, 0))  # -> Geometry, Transform
end = EndPoints(Curve=move.Geometry)  # -> Start, End
ln_7 = Line(StartPoint=end.End, EndPoint=C)
curvepoint = PointOnCurve(ln_7, parameter=0.5)
pdecon = Deconstruct(Point=curvepoint)  # -> XComponent, YComponent, ZComponent
curvepoint_2 = PointOnCurve(move.Geometry, parameter=0.5)
vec = VectorXYZ(XComponent=1, YComponent=0, ZComponent=0)  # -> Vector, Length
G = ConstructPoint(XCoordinate=subtraction_2, YCoordinate=pdecon.YComponent, ZCoordinate=0)
move_2 = Move(Geometry=curvepoint_2, Motion=vec.Vector)  # -> Geometry, Transform

expression_11 = Expression(x=bust, Expression="-(x/4-2.5)")
xy = XYPlane(Origin=Point(0, 0, 0))
vec2pt = Vector2Pt(PointA=bp, PointB=G, Unitize=False)  # -> Vector, Length
rad = Radians(Degrees=expression_11)
panel = Panel("CHEST DART")
vrot = Rotate(Vector=vec2pt.Vector, Axis=xy, Angle=rad)
ln_8 = Line(StartPoint=bp, EndPoint=G)
len = Length(Curve=ln_8)
line = LineSDL(Start=bp, Direction=vrot, Length=len)

addition_3 = Addition(A=expression, B=0.5)
neg = Negative(Value=expression)
neg_2 = Negative(Value=addition_3)
vec_2 = VectorXYZ(XComponent=neg, YComponent=neg_2, ZComponent=0)  # -> Vector, Length
expression_12 = Expression(x=vec_2.Length, Expression="2/3*x +0.5")
panel_2 = Panel("FRONT NECKLINE")
vec_3 = VectorXYZ(XComponent=neg, YComponent=0, ZComponent=0)  # -> Vector, Length
vec_4 = VectorXYZ(XComponent=0, YComponent=neg_2, ZComponent=0)  # -> Vector, Length
amp = Amplitude(Vector=vec_2.Vector, Amplitude=expression_12)
move_3 = Move(Geometry=B, Motion=vec_4.Vector)  # -> Geometry, Transform
move_4 = Move(Geometry=B, Motion=amp)  # -> Geometry, Transform
move_5 = Move(Geometry=B, Motion=vec_3.Vector)  # -> Geometry, Transform
arc = Arc3Pt(PointA=move_5.Geometry, PointB=move_4.Geometry, PointC=move_3.Geometry)  # -> Arc, Plane, Radius

num = Number(22)
rad_2 = Radians(Degrees=num)
len_2 = Length(Curve=ln)
pi = Pi(Factor=1)
subtraction_5 = Subtraction(A=len_2, B=expression)
cos = Cosine(Value=rad_2)
addition_4 = Addition(A=rad_2, B=pi)
xy_2 = XYPlane(Origin=Point(0, 0, 0))
X = UnitX(Factor=1)
division = Division(A=subtraction_5, B=cos)
vrot_2 = Rotate(Vector=X, Axis=xy_2, Angle=addition_4)
panel_3 = Panel("FRONT SHOULDER")
addition_5 = Addition(A=division, B=1.8)
line_2 = LineSDL(Start=move_5.Geometry, Direction=vrot_2, Length=addition_5)

expression_13 = Expression(x=bust, Expression="x/32-0.8")
X_2 = UnitX(Factor=1)
rad_3 = Radians(Degrees=-18)
xy_3 = XYPlane(Origin=Point(0, 0, 0))
addition_6 = Addition(A=addition_5, B=expression_13)
panel_4 = Panel("BACK SHOULDER")
vrot_3 = Rotate(Vector=X_2, Axis=xy_3, Angle=rad_3)
line_3 = LineSDL(Start=pt_7, Direction=vrot_3, Length=addition_6)

pi_2 = Pi(Factor=1.5)
vrot_4 = Rotate(Vector=vrot_3, Axis=xy_3, Angle=pi_2)
X_3 = UnitX(Factor=5)
panel_5 = Panel("BACK NECKLINE")
line_4 = LineSDL(Start=pt_7, Direction=vrot_4, Length=1)
amp_2 = Amplitude(Vector=vrot_4, Amplitude=1.5)
bzspan = BezierSpan(StartPoint=a2, StartTangent=X_3, EndPoint=pt_7, EndTangent=amp_2)  # -> Curve, Length, Domain

pi_3 = Pi(Factor=0.5)
xy_4 = XYPlane(Origin=Point(0, 0, 0))
addition_7 = Addition(A=rad_3, B=pi_3)
X_4 = UnitX(Factor=1)
expression_14 = Expression(x=bust, Expression="(X/32-0.8)/2")
vrot_5 = Rotate(Vector=X_4, Axis=xy_4, Angle=addition_7)
Z = UnitZ(Factor=1)
pl = ConstructPlane(Origin=move_2.Geometry, XAxis=vrot_5, YAxis=Z)
end_2 = EndPoints(Curve=line_3)  # -> Start, End
plx = LinePlane(Line=line_3, Plane=pl)  # -> Point, ParamL, ParamP
vec2pt_2 = Vector2Pt(PointA=end_2.End, PointB=plx.Point, Unitize=False)  # -> Vector, Length
vec2pt_3 = Vector2Pt(PointA=end_2.Start, PointB=plx.Point, Unitize=False)  # -> Vector, Length
line_5 = LineSDL(Start=plx.Point, Direction=vec2pt_2.Vector, Length=expression_14)
line_6 = LineSDL(Start=plx.Point, Direction=vec2pt_3.Vector, Length=expression_14)
panel_6 = Panel("SHOULDER DART")
end_3 = EndPoints(Curve=line_6)  # -> Start, End
end_4 = EndPoints(Curve=line_5)  # -> Start, End
ln_9 = Line(StartPoint=move_2.Geometry, EndPoint=end_4.End)
ln_10 = Line(StartPoint=move_2.Geometry, EndPoint=end_3.End)

dist = Distance(PointA=curvepoint, PointB=G)
vec_5 = VectorXYZ(XComponent=1, YComponent=1, ZComponent=0)  # -> Vector, Length
vec_6 = VectorXYZ(XComponent=-1, YComponent=1, ZComponent=0)  # -> Vector, Length
expression_15 = Expression(x=dist, Expression="x/6")
addition_8 = Addition(A=expression_15, B=0.8)
addition_9 = Addition(A=expression_15, B=0.6)
amp_3 = Amplitude(Vector=vec_6.Vector, Amplitude=addition_9)
amp_4 = Amplitude(Vector=vec_5.Vector, Amplitude=addition_8)
panel_7 = Panel("ARMHOLE")
move_6 = Move(Geometry=F, Motion=amp_3)  # -> Geometry, Transform
move_7 = Move(Geometry=C, Motion=amp_4)  # -> Geometry, Transform
data = Data([G, move_6.Geometry, pt_6, move_7.Geometry, curvepoint, end_2.End])
intcrv = Interpolate(Vertices=data, Degree=3, Periodic=False, KnotStyle=2)  # -> Curve, Length, Domain

end_5 = EndPoints(Curve=line_2)  # -> Start, End
end_6 = EndPoints(Curve=line)  # -> Start, End
ln_11 = Line(StartPoint=end_6.End, EndPoint=end_5.End)
bustline_y = Number(subtraction_3)
bust_3 = Number(bust)
waist_2 = Number(waist)
expression_16 = Expression(x=waist_2, Expression="x/2+3")
expression_17 = Expression(x=bust_3, Expression="x/2 + 6")
subtraction_6 = Subtraction(A=expression_17, B=expression_16)
total_waist_dart = Number(subtraction_6)

end_7 = EndPoints(Curve=ln_8)  # -> Start, End
pt_9 = Point(G)
pt_10 = Point(bp)
pdecon_2 = Deconstruct(Point=pt_9)  # -> XComponent, YComponent, ZComponent
pdecon_3 = Deconstruct(Point=pt_10)  # -> XComponent, YComponent, ZComponent
vec2pt_4 = Vector2Pt(PointA=end_7.End, PointB=end_7.Start, Unitize=False)  # -> Vector, Length
X_5 = UnitX(Factor=1)
angle = Angle(VectorA=X_5, VectorB=vec2pt_4.Vector)  # -> Angle, Reflex
addition_10 = Addition(A=pdecon_2.XComponent, B=1.5)
tan = Tangent(Value=angle.Angle)
subtraction_7 = Subtraction(A=pdecon_3.XComponent, B=addition_10)
num_2 = Number(0.15)
multiplication = Multiplication(A=total_waist_dart, B=num_2)
multiplication_2 = Multiplication(A=subtraction_7, B=tan)
division_2 = Division(A=multiplication, B=2)
addition_11 = Addition(A=multiplication_2, B=pdecon_3.YComponent)
neg_3 = Negative(Value=division_2)
pt_11 = ConstructPoint(XCoordinate=addition_10, YCoordinate=addition_11, ZCoordinate=0)
pt_12 = ConstructPoint(XCoordinate=addition_10, YCoordinate=0, ZCoordinate=0)
vec_7 = VectorXYZ(XComponent=division_2, YComponent=0, ZComponent=0)  # -> Vector, Length
vec_8 = VectorXYZ(XComponent=neg_3, YComponent=0, ZComponent=0)  # -> Vector, Length
panel_8 = Panel("Side front dart")
move_8 = Move(Geometry=pt_12, Motion=vec_7.Vector)  # -> Geometry, Transform
move_9 = Move(Geometry=pt_12, Motion=vec_8.Vector)  # -> Geometry, Transform
ln_12 = Line(StartPoint=pt_11, EndPoint=pt_12)
ln_13 = Line(StartPoint=pt_11, EndPoint=move_8.Geometry)
ln_14 = Line(StartPoint=pt_11, EndPoint=move_9.Geometry)

multiplication_3 = Multiplication(A=total_waist_dart, B=0.07)
panel_9 = Panel("Center back dart")
pt_13 = ConstructPoint(XCoordinate=multiplication_3, YCoordinate=0, ZCoordinate=0)
ln_15 = Line(StartPoint=a2, EndPoint=pt_13)

pt_14 = Point(pt_8)
pt_15 = Point(pt_6)
num_3 = Number(0.11)
multiplication_4 = Multiplication(A=total_waist_dart, B=num_3)
division_3 = Division(A=multiplication_4, B=2)
neg_4 = Negative(Value=division_3)
vec_9 = VectorXYZ(XComponent=division_3, YComponent=0, ZComponent=0)  # -> Vector, Length
vec_10 = VectorXYZ(XComponent=neg_4, YComponent=0, ZComponent=0)  # -> Vector, Length
panel_10 = Panel("Side dart")
move_10 = Move(Geometry=pt_14, Motion=vec_9.Vector)  # -> Geometry, Transform
move_11 = Move(Geometry=pt_14, Motion=vec_10.Vector)  # -> Geometry, Transform
ln_16 = Line(StartPoint=pt_15, EndPoint=move_10.Geometry)
ln_17 = Line(StartPoint=pt_15, EndPoint=move_11.Geometry)

pdecon_4 = Deconstruct(Point=curvepoint_2)  # -> XComponent, YComponent, ZComponent
addition_12 = Addition(A=bustline_y)
num_4 = Number(0.18)
multiplication_5 = Multiplication(A=total_waist_dart, B=num_4)
division_4 = Division(A=multiplication_5, B=2)
neg_5 = Negative(Value=division_4)
pt_16 = ConstructPoint(XCoordinate=pdecon_4.XComponent, YCoordinate=addition_12, ZCoordinate=0)
pt_17 = ConstructPoint(XCoordinate=pdecon_4.XComponent, YCoordinate=0, ZCoordinate=0)
vec_11 = VectorXYZ(XComponent=neg_5, YComponent=0, ZComponent=0)  # -> Vector, Length
vec_12 = VectorXYZ(XComponent=division_4, YComponent=0, ZComponent=0)  # -> Vector, Length
move_12 = Move(Geometry=pt_17, Motion=vec_12.Vector)  # -> Geometry, Transform
move_13 = Move(Geometry=pt_17, Motion=vec_11.Vector)  # -> Geometry, Transform
panel_11 = Panel("Back waist dart")
ln_18 = Line(StartPoint=pt_16, EndPoint=pt_17)
ln_19 = Line(StartPoint=move_12.Geometry, EndPoint=pt_16)
ln_20 = Line(StartPoint=move_13.Geometry, EndPoint=pt_16)

pt_18 = Point(bp)
num_5 = Number(0.14)
multiplication_6 = Multiplication(A=total_waist_dart, B=num_5)
division_5 = Division(A=multiplication_6, B=2)
pdecon_5 = Deconstruct(Point=pt_18)  # -> XComponent, YComponent, ZComponent
neg_6 = Negative(Value=division_5)
pt_19 = ConstructPoint(XCoordinate=pdecon_5.XComponent, YCoordinate=pdecon_5.YComponent, ZCoordinate=0)
pt_20 = ConstructPoint(XCoordinate=pdecon_5.XComponent, YCoordinate=0, ZCoordinate=0)
vec_13 = VectorXYZ(XComponent=division_5, YComponent=0, ZComponent=0)  # -> Vector, Length
vec_14 = VectorXYZ(XComponent=neg_6, YComponent=0, ZComponent=0)  # -> Vector, Length
move_14 = Move(Geometry=pt_20, Motion=vec_13.Vector)  # -> Geometry, Transform
move_15 = Move(Geometry=pt_20, Motion=vec_14.Vector)  # -> Geometry, Transform
panel_12 = Panel("Front Dart")
ln_21 = Line(StartPoint=pt_19, EndPoint=move_14.Geometry)
ln_22 = Line(StartPoint=pt_19, EndPoint=move_15.Geometry)
ln_23 = Line(StartPoint=pt_19, EndPoint=pt_20)

num_6 = Number(0.35)
multiplication_7 = Multiplication(A=total_waist_dart, B=num_6)
pdecon_6 = Deconstruct(Point=curvepoint)  # -> XComponent, YComponent, ZComponent
division_6 = Division(A=multiplication_7, B=2)
subtraction_8 = Subtraction(A=pdecon_6.XComponent, B=1)
neg_7 = Negative(Value=division_6)
pt_21 = ConstructPoint(XCoordinate=subtraction_8, YCoordinate=pdecon_6.YComponent, ZCoordinate=0)
pt_22 = ConstructPoint(XCoordinate=subtraction_8, YCoordinate=0, ZCoordinate=0)
vec_15 = VectorXYZ(XComponent=division_6, YComponent=0, ZComponent=0)  # -> Vector, Length
vec_16 = VectorXYZ(XComponent=neg_7, YComponent=0, ZComponent=0)  # -> Vector, Length
panel_13 = Panel("Side back dart")
move_16 = Move(Geometry=pt_22, Motion=vec_15.Vector)  # -> Geometry, Transform
move_17 = Move(Geometry=pt_22, Motion=vec_16.Vector)  # -> Geometry, Transform
ln_24 = Line(StartPoint=pt_21, EndPoint=move_17.Geometry)
ln_25 = Line(StartPoint=pt_21, EndPoint=pt_22)
ln_26 = Line(StartPoint=pt_21, EndPoint=move_16.Geometry)

torso_sloper = Geometry([ln_10, ln_9, line, ln_8, intcrv.Curve, ln_11, line_2, arc.Arc, line_3, bzspan.Curve, ln_15, ln_18, ln_19, ln_20, ln_25, ln_26, ln_24, ln_16, ln_17, ln_12, ln_13, ln_14, ln_23, ln_21, ln_22, ln_3, bl_line, ln_5, ln_4, ln_2])
hip_depth = Slider(20, range=10..30)
hip = Slider(88, range=40..100)
skirt_length = Slider(42, range=10..50)
expression_18 = Expression(x=hip, Expression="x/2+6")
subtraction_9 = Subtraction(A=expression_18, B=expression_16)
total_waist_dart_skirt = Number(subtraction_9)
skirt_offset = Integer(-2)

addition_13 = Addition(A=skirt_offset, B=skirt_length)
panel_14 = Panel("skirt outline")
neg_8 = Negative(Value=addition_13)
pt_23 = ConstructPoint(XCoordinate=expression_18, YCoordinate=skirt_offset, ZCoordinate=0)
pt_24 = ConstructPoint(XCoordinate=0, YCoordinate=skirt_offset, ZCoordinate=0)
pt_25 = ConstructPoint(XCoordinate=0, YCoordinate=neg_8, ZCoordinate=0)
pt_26 = ConstructPoint(XCoordinate=expression_18, YCoordinate=neg_8, ZCoordinate=0)
ln_27 = Line(StartPoint=pt_25, EndPoint=pt_26)
ln_28 = Line(StartPoint=pt_24, EndPoint=pt_25)
ln_29 = Line(StartPoint=pt_26, EndPoint=pt_23)
ln_30 = Line(StartPoint=pt_24, EndPoint=pt_23)

addition_14 = Addition(A=hip_depth, B=skirt_offset)
panel_15 = Panel("hip line")
neg_9 = Negative(Value=addition_14)
pt_27 = ConstructPoint(XCoordinate=expression_18, YCoordinate=neg_9, ZCoordinate=0)
pt_28 = ConstructPoint(XCoordinate=0, YCoordinate=neg_9, ZCoordinate=0)
ln_31 = Line(StartPoint=pt_28, EndPoint=pt_27)

num_7 = Number(0.07)
multiplication_8 = Multiplication(A=total_waist_dart_skirt, B=num_7)
pt_29 = ConstructPoint(XCoordinate=multiplication_8, YCoordinate=skirt_offset, ZCoordinate=0)
ln_32 = Line(StartPoint=pt_28, EndPoint=pt_29)

num_8 = Number(0.18)
multiplication_9 = Multiplication(A=total_waist_dart_skirt, B=num_8)
dist_2 = Distance(PointA=pt_13, PointB=move_13.Geometry)
addition_15 = Addition(A=multiplication_8, B=dist_2)
addition_16 = Addition(A=addition_15, B=multiplication_9)
pt_30 = ConstructPoint(XCoordinate=addition_15, YCoordinate=skirt_offset, ZCoordinate=0)
pt_31 = ConstructPoint(XCoordinate=addition_16, YCoordinate=skirt_offset, ZCoordinate=0)
division_7 = Division(A=multiplication_9, B=2)
addition_17 = Addition(A=addition_15, B=division_7)
pt_32 = ConstructPoint(XCoordinate=addition_17, YCoordinate=neg_9, ZCoordinate=0)
ln_33 = Line(StartPoint=pt_30, EndPoint=pt_32)
ln_34 = Line(StartPoint=pt_32, EndPoint=pt_31)

num_9 = Number(0.15)
multiplication_10 = Multiplication(A=total_waist_dart_skirt, B=num_9)
dist_3 = Distance(PointA=move_12.Geometry, PointB=move_17.Geometry)
addition_18 = Addition(A=addition_16, B=dist_3)
addition_19 = Addition(A=addition_18, B=multiplication_10)
pt_33 = ConstructPoint(XCoordinate=addition_19, YCoordinate=skirt_offset, ZCoordinate=0)
pt_34 = ConstructPoint(XCoordinate=addition_18, YCoordinate=skirt_offset, ZCoordinate=0)
division_8 = Division(A=multiplication_10, B=2)
addition_20 = Addition(A=addition_18, B=division_8)
pt_35 = ConstructPoint(XCoordinate=addition_20, YCoordinate=neg_9, ZCoordinate=0)
ln_35 = Line(StartPoint=pt_34, EndPoint=pt_35)
ln_36 = Line(StartPoint=pt_35, EndPoint=pt_33)

num_10 = Number(0.35)
multiplication_11 = Multiplication(A=total_waist_dart_skirt, B=num_10)
dist_4 = Distance(PointA=move_16.Geometry, PointB=move_11.Geometry)
addition_21 = Addition(A=addition_19, B=dist_4)
addition_22 = Addition(A=addition_21, B=multiplication_11)
pt_36 = ConstructPoint(XCoordinate=addition_21, YCoordinate=skirt_offset, ZCoordinate=0)
pt_37 = ConstructPoint(XCoordinate=addition_22, YCoordinate=skirt_offset, ZCoordinate=0)
division_9 = Division(A=multiplication_11, B=2)
addition_23 = Addition(A=addition_21, B=division_9)
pt_38 = ConstructPoint(XCoordinate=addition_23, YCoordinate=neg_9, ZCoordinate=0)
ln_37 = Line(StartPoint=pt_38, EndPoint=pt_37)
ln_38 = Line(StartPoint=pt_36, EndPoint=pt_38)

num_11 = Number(0.11)
multiplication_12 = Multiplication(A=total_waist_dart_skirt, B=num_11)
dist_5 = Distance(PointA=move_10.Geometry, PointB=move_9.Geometry)
addition_24 = Addition(A=addition_22, B=dist_5)
addition_25 = Addition(A=addition_24, B=multiplication_12)
pt_39 = ConstructPoint(XCoordinate=addition_24, YCoordinate=skirt_offset, ZCoordinate=0)
pt_40 = ConstructPoint(XCoordinate=addition_25, YCoordinate=skirt_offset, ZCoordinate=0)
division_10 = Division(A=multiplication_12, B=2)
addition_26 = Addition(A=addition_24, B=division_10)
pt_41 = ConstructPoint(XCoordinate=addition_26, YCoordinate=neg_9, ZCoordinate=0)
ln_39 = Line(StartPoint=pt_39, EndPoint=pt_41)
ln_40 = Line(StartPoint=pt_41, EndPoint=pt_40)

num_12 = Number(0.14)
multiplication_13 = Multiplication(A=total_waist_dart_skirt, B=num_12)
dist_6 = Distance(PointA=move_8.Geometry, PointB=move_15.Geometry)
addition_27 = Addition(A=addition_25, B=dist_6)
addition_28 = Addition(A=addition_27, B=multiplication_13)
pt_42 = ConstructPoint(XCoordinate=addition_27, YCoordinate=skirt_offset, ZCoordinate=0)
pt_43 = ConstructPoint(XCoordinate=addition_28, YCoordinate=skirt_offset, ZCoordinate=0)
division_11 = Division(A=multiplication_13, B=2)
addition_29 = Addition(A=addition_27, B=division_11)
pt_44 = ConstructPoint(XCoordinate=addition_29, YCoordinate=neg_9, ZCoordinate=0)
ln_41 = Line(StartPoint=pt_42, EndPoint=pt_44)
ln_42 = Line(StartPoint=pt_44, EndPoint=pt_43)

dist_7 = Distance(PointA=move_14.Geometry, PointB=b2)
addition_30 = Addition(A=addition_28, B=dist_7)
pt_45 = ConstructPoint(XCoordinate=addition_30, YCoordinate=skirt_offset, ZCoordinate=0)
skirt_sloper = Geometry([ln_31, ln_28, ln_27, ln_29, ln_30, ln_32, ln_33, ln_34, ln_35, ln_36, ln_38, ln_37, ln_39, ln_40, ln_41, ln_42])
